# Grasshopper definition ex2_brickwall.ghx (Grasshopper 1.0.8)

# ----
# Create a brick part
part = Python3Script()  # -> out, brick_full, brick_half
# ---------- part: Python ----------
from compas.geometry import Frame
from compas.geometry import Vector
from compas.geometry import Box

from assembly_information_model import Part



# dimensions full brick
width = 0.115
length = 0.240
height = 0.050

# create bricks
tool_frame = Frame([0, 0, height], [1, 0, 0], [0, -1, 0])
brick_full_geometry = Box(length, width, height, tool_frame, 'box')
brick_full = Part.from_shape(brick_full_geometry, name="brick_full", frame=tool_frame)

brick_half_geometry = Box(length/2, width, height, tool_frame, 'box')
brick_half = Part.from_shape(brick_half_geometry, name="brick_full", frame=tool_frame)
# ---------- end part ----------
show = Python3Script(brick_full=part.brick_full, brick_half=part.brick_half, show=Toggle(True))  # -> out, plane, mesh
# ---------- show: Python ----------
from compas_rhino.conversions import mesh_to_rhino, box_to_rhino, frame_to_rhino


if show:

    #extract the mesh of the part for visulization
    full_mesh = brick_full.mesh
    half_mesh = brick_half.mesh
    #convert to rhino mesh
    mesh = [mesh_to_rhino(full_mesh), mesh_to_rhino(half_mesh)]
    
    #extract the frame of the part for visulization
    full_frame = brick_full.frame
    half_frame = brick_half.frame
    #convert to rhino plane
    plane = [frame_to_rhino(full_frame), frame_to_rhino(half_frame)]
# ---------- end show ----------
pln = Plane(show.plane)
geo = Geometry(show.mesh)

# ----
# Unload Python modules
button = Button()
unload = Python3Script(unload=button)  # -> out, a
# ---------- unload: Python ----------
from compas_rhino import unload_modules

unload_modules('assembly_information_model')
unload_modules('assembly_information_model.assembly')
unload_modules('assembly_information_model.part')
# ---------- end unload ----------

import = Button(ExpressionNormal="True", ExpressionPressed="False")

# ----
# Import from JSON
path = Python3Script()  # -> HERE, DATA
# ---------- path: Python ----------
import os

HERE = os.path.dirname(ghdoc.Path)
DATA = os.path.abspath(os.path.join(HERE, "..", "data"))
print(HERE)
print(DATA)
# ---------- end path ----------
initial_assembly = Python3Script(DATA=path.DATA, filename="ex_brickwall.json", import_from_json=import)  # -> out, assembly
# ---------- initial_assembly: Python ----------
import os
import json

from assembly_information_model import Assembly

if import_from_json:
    filename = filename
    PATH = os.path.join(DATA, filename)
    print(PATH)
    assembly = Assembly.from_json(PATH)
    print(assembly)
# ---------- end initial_assembly ----------

cp_new = Plane(PlaneXY(-0.4, 0.7925, -0.487))

# ----
# Generate a brickwall assembly
cp = Plane(PlaneXY(-0.1484965898, 0.1341283439, 0))
pt = Point(Point(0.8153358976, 0.02270564147, 0))
generate_parts = Python3Script(brick_full=part.brick_full, brick_half=part.brick_half, center_plane=cp, attr_pts=pt)  # -> out, assembly, courses; inputs center_plane: Plane, attr_pts: list
# ---------- generate_parts: Python ----------
import math

from compas.geometry import Frame, Point
from compas.geometry import Transformation, Rotation, Translation
from compas.geometry import distance_point_point
from compas_rhino.conversions import plane_to_compas_frame, frame_to_rhino_plane, point_to_compas

from assembly_information_model.assembly import Assembly

#create empty assembly
assembly = Assembly()

center_frame = plane_to_compas_frame(center_plane)

brick_shape = brick_full.shape
length, width, height = [brick_shape.xsize, brick_shape.ysize, brick_shape.zsize]

courses = 13
bricks_per_course = 4
mortar_perfends = 0.025

total_length = bricks_per_course * length + (bricks_per_course - 1) * mortar_perfends
gap_even = mortar_perfends
gap_uneven = (total_length - (bricks_per_course * (length))) / bricks_per_course

for course in range(courses):
    dz = course * height #height of brick
    dx = 0 #front direction

    half_brick_layer = course % 2 != 0 #every second layer

    gap = gap_uneven if half_brick_layer else gap_even
    bricks_in_course = bricks_per_course + (1 if half_brick_layer else 0)

    for j in range(bricks_in_course):

        first = j == 0
        last = j == bricks_in_course - 1

        is_half_brick = (first or last) and half_brick_layer
        
        if is_half_brick:
            T = Translation.from_vector([dx - width/2, 0, dz])
            part = brick_half.transformed(T)
            dx += length/2
        else:
            T = Translation.from_vector([dx, 0, dz])
            part = brick_full.transformed(T)
            dx += length
        
        
        #apply rotation to the bricks according to the distance of the attractor points
        # min_dist = 10
        # for attr_pt in attr_pts:
        #     dist =  distance_point_point(point_to_compas(attr_pt), part.frame.point)
        #     if dist < min_dist:
        #         min_dist = dist
        # dist = min_dist
        # R = Rotation.from_axis_and_angle([0,0,1], math.radians(1/(0.3*dist*dist)), point=part.frame.point) 
        # part.transform(R)
        
        typology = "half" if is_half_brick else "full"

        assembly.add_part(part, course=course, typology=typology)
        dx += gap
# ---------- end generate_parts ----------
add_connections = Python3Script(assembly=generate_parts.assembly, courses=generate_parts.courses)  # -> out, assembly
# ---------- add_connections: Python ----------
for course in range(courses-1):
    bricks_current_course = [assembly.find_by_key(key) for key in assembly.graph.nodes_where({'course': course})]
    bricks_next_course = [assembly.find_by_key(key) for key in assembly.graph.nodes_where({'course': course + 1})]

    for k in range(len(bricks_current_course)):
        if course % 2 != 0:
            if k == 0:
                assembly.add_connection(bricks_current_course[k],bricks_next_course[k])
            elif k == (len(bricks_current_course)-1):
                assembly.add_connection(bricks_current_course[k],bricks_next_course[k-1])
            else: 
                assembly.add_connection(bricks_current_course[k],bricks_next_course[k-1])
                assembly.add_connection(bricks_current_course[k],bricks_next_course[k])
        else:
            for k in range(len(bricks_current_course)):
                assembly.add_connection(bricks_current_course[k],bricks_next_course[k+1])
                assembly.add_connection(bricks_current_course[k],bricks_next_course[k])
# ---------- end add_connections ----------
transform = Python3Script(assembly=add_connections.assembly, transform=Toggle(True), center_plane=cp, center_plane_new=cp_new)  # -> out, assembly
# ---------- transform: Python ----------
from compas.geometry import Frame, Transformation, Rotation, Translation
from compas_rhino.conversions import plane_to_compas_frame

center_frame = plane_to_compas_frame(center_plane)
center_frame_new = plane_to_compas_frame(center_plane_new)


if transform:
    T = Transformation.from_frame_to_frame(center_frame, center_frame_new)
    assembly = assembly.transformed(T)
# ---------- end transform ----------

# ----
# Export to JSON
export = Button()
path_2 = Python3Script()  # -> out, DATA
# ---------- path_2: Python ----------
import os
import getpass

username = getpass.getuser()
USER_FOLDER = os.path.abspath(os.path.join("C:/Users/", username))
DATA = os.path.abspath(os.path.join(USER_FOLDER,"workspace/robotic-fabrication-in-architecture/code/05-assembly/examples/data"))

print(USER_FOLDER)
print(DATA)
# ---------- end path_2 ----------
export_2 = Python3Script(DATA=path_2.DATA, assembly=transform.assembly, export=export)  # -> out
# ---------- export_2: Python ----------
import os

if export:
    
    filename = "ex_brickwall.json"
    PATH = os.path.join(DATA, filename)
    
    # the assembly has to be serialized such that it can be called from CPython
    assembly.to_json(PATH)
# ---------- end export_2 ----------

# ----
# Transform
toggle = BooleanToggle(True)
plane_new = Plane(Plane(origin=(1.146937571, 0.5012943088, 0), x=(0, -1, 0), y=(1, 0, 0)))
transform_assembly = Python3Script(assembly=initial_assembly.assembly, transform=toggle, center_plane_new=plane_new)  # -> out, assembly, node, nodes, plane_c
# ---------- transform_assembly: Python ----------
from compas.geometry import Frame, Transformation, Rotation, Translation
from compas_rhino.conversions import plane_to_compas_frame, point_to_rhino, frame_to_rhino

center_frame = Frame.worldXY()
center_frame_new = plane_to_compas_frame(center_plane_new)


if transform:
    T = Transformation.from_frame_to_frame(center_frame, center_frame_new)
    assembly = assembly.transformed(T)
    

    # Iterate through the parts in the assembly
    for part in assembly.parts():
        # Get the node corresponding to the part's key
        node = assembly.graph.node[part.key]

        # Check for the presence of 'a', 'b', 'c', and 'd' attributes in the node
        if 'a' in node:
            # Get the Frame object, transform it, and store the transformed Frame back
            frame_a = node['a']  # Get the Frame object
            frame_a.transform(T)  # Transform the Frame
            node['a'] = frame_a  # Store the transformed Frame back
            # node_a = frame_a.transformed(T) # Alternative: create a new transformed copy

        if 'b' in node:
            frame_b = node['b']
            frame_b.transform(T)
            node['b'] = frame_b

        if 'c' in node:
            frame_c = node['c']
            frame_c.transform(T)
            node['c'] = frame_c
            print(type(frame_c))
            plane_c = frame_to_rhino(frame_c)
            print(plane_c)
            #print(type(node['c']))  # Verify the type (should be <class 'compas.geometry.Frame'>)

        if 'd' in node:
            frame_d = node['d']
            frame_d.transform(T)
            node['d'] = frame_d
# ---------- end transform_assembly ----------

reset = Button()
back = Button()
start = Button()
stop = Button()
step = Button()
full = Button()
list = ValueList({"20", "50", "100", "500", "1000", "5000"}, selected="500")
counter = Python3Script(my_assembly=transform.assembly, start=start, stop=stop, step=step, step_back=back, reset=reset, full=full, interval=list)  # -> out, counter
# ---------- counter: Python ----------
from scriptcontext import sticky as st
import Grasshopper

def update_component(ghenv, delay):
    """Schedule an update of the Grasshopper component.

    After the specified delay, the GH component will be automatically updated.

    Parameters
    ----------
    ghenv : :class:`GhPython.Component.PythonEnvironment`
        The current GHPython environment.
    delay : :obj:`int`
        Time in milliseconds until the update is performed.

    Raises
    ------
    ValueError
        If the delay is less than zero.

    """
    if delay <= 0:
        raise ValueError("Delay must be greater than zero")

    ghcomp = ghenv.Component
    ghdoc = ghcomp.OnPingDocument()

    def callback(ghdoc):
        if ghdoc.SolutionState != Grasshopper.Kernel.GH_ProcessStep.Process:
            ghcomp.ExpireSolution(False)

    ghdoc.ScheduleSolution(delay, Grasshopper.Kernel.GH_Document.GH_ScheduleDelegate(callback))

L = range(my_assembly.graph.number_of_nodes())

# store data in component
guid = str(ghenv.Component.InstanceGuid)
counter_key = "counter_" + guid
running_key = "running_" + guid

if counter_key not in st:
    st[counter_key] = 0

if running_key not in st:
    st[running_key] = False
    

if st[running_key]:
    if st[counter_key] < len(L) - 1:
        st[counter_key] += 1
        update_component(ghenv, interval)
    else:
        st[counter_key] = 0
        st[running_key] = False
    
if start:
    st[running_key] = True

if stop:
    st[running_key] = False

if step:
    if st[counter_key] < len(L) - 1:
        st[counter_key] += 1

if step_back:
    if st[counter_key] < len(L) - 1:
        st[counter_key] -= 1

if reset:
    st[counter_key] = 0
    st[running_key] = False

if full:
    st[counter_key] = len(L)-1

if len(L):
    item = L[st[counter_key]]


#st["visualisation_counter"] = st[counter_key]
counter = st[counter_key]+1
# ---------- end counter ----------
panel = Panel(counter.counter)

# ----
# Draw
list_2 = ValueList({"show all": "show_all", "show until key": "show_until_key"}, selected="show all")
visualize = Python3Script(
    assembly=transform.assembly,
    show=list_2,
    highlight_current_part=Toggle(True),
    show_connections=Toggle(True),
    counter=counter.counter)  # -> out, parts_geometry, parts_frame, current_part_geometry, current_part_frame, connections
# ---------- visualize: Python ----------
from compas_rhino.conversions import mesh_to_rhino, box_to_rhino, frame_to_rhino, line_to_rhino
from compas.geometry import Line

#print assembly
print(assembly)

#get parts datastructure
parts = [p for p in assembly.parts()]

if show == "show_all":
    
    #extract the mesh of the parts for visulization (+ converted to rhino mesh)
    parts_geometry = [mesh_to_rhino(p.mesh) for p in parts]
    
    #extract the frame of the parts for visulization (+ converted to rhino plane)
    parts_frame = [frame_to_rhino(p.frame) for p in parts]

    key = assembly.graph.number_of_nodes()-1

if show == "show_until_key":
    #extract the mesh of the parts for visulization (+ converted to rhino mesh)
    parts_geometry = [mesh_to_rhino(p.mesh) for p in parts[0:counter]]
    
    #extract the frame of the parts for visulization (+ converted to rhino plane)
    parts_frame = [frame_to_rhino(p.frame) for p in parts[0:counter]]

    key = counter-1

if highlight_current_part:
    current_part = assembly.part(key)
    current_part_geometry = mesh_to_rhino(current_part.mesh)
    current_part_frame = frame_to_rhino(current_part.frame)

if show_connections:
    connections = [line_to_rhino(Line(assembly.find_by_key(start).frame.point, assembly.find_by_key(end).frame.point)) for start, end in assembly.graph.edges()]
# ---------- end visualize ----------
panel_2 = Panel(visualize.out)
colour_swatch = ColourSwatch(SwatchColor=RGB(255, 125, 157))
geo_2 = Geometry(visualize.parts_geometry)
geo_3 = Geometry(visualize.parts_frame)
geo_4 = Geometry([visualize.current_part_geometry, visualize.current_part_frame])
preview = CustomPreview(Geometry=geo_3, Material=ColourSwatch(SwatchColor=RGB(242, 0, 0)))
preview_2 = CustomPreview(Geometry=geo_4, Material=colour_swatch)
preview_3 = CustomPreview(Geometry=geo_2, Material=ColourSwatch(SwatchColor=RGBA(255, 227, 227, 233)))

colour_swatch_2 = ColourSwatch(SwatchColor=RGB(255, 125, 157))
line = Line(visualize.connections)
preview_4 = CustomPreview(Geometry=line, Material=colour_swatch)
